vi "index.gviweb"   [LabVIEW NXG 5.0.0]
panel controls:
  "Código pz": T1 = "0"
  "Piezas": f64
  "Paro": bool
panel indicators:
  "Cortador": bool
  "Avance": bool
  "Encoder": f64
  "Rodillos": bool
  "Contador pz": f64
  "Registro": string
  "URL Image": string
  "URL Image_2": string
types:
  T1 = enum{"0", "91X183", "91X244", "91X305", "91X366", "91X914", "91X1220", "91X1400"}
diagram:
  s1 = uninitialised  # shift register
  while {
    case ($"Código pz") {
      frame "0" {
        $Rodillos <- FALSE
        $Cortador <- FALSE
        $Avance <- TRUE
        $Encoder <- 0
        w1 = s1
        w2 = 0
        w3 = "0"
      }
      frame "91X183" {
        Add(s1, 1) -> w4
        Is Greater Or Equal(x=w4, y=183) -> w5
        case (w5) {
          frame False, Default {
            $Cortador <- FALSE
          }
          frame True {
            Wait(time to wait=300)
            $Cortador <- TRUE
          }
        }
        case (w5) {
          frame False, Default {
            w2 = $"Contador pz"
          }
          frame True {
            Increment(x=$"Contador pz") -> w2
          }
        }
        Is Equal(x=w2, y=$Piezas) -> w6
        case (w6) {
          frame False, Default { }
          frame True {
            $"Código pz" <- "0"
          }
        }
        Wait(time to wait=15)
        $Avance <- TRUE
        $Encoder <- w4
        case (w5) {
          frame False, Default {
            w1 = w4
          }
          frame True {
            Subtract(x=w4, y=183) -> w1
          }
        }
        $Rodillos <- TRUE
        w3 = "91X863"
      }
      frame "91X244" {
        Add(s1, 1) -> w7
        Is Greater Or Equal(x=w7, y=183) -> w8
        case (w8) {
          frame False, Default {
            $Cortador <- FALSE
          }
          frame True {
            Wait(time to wait=300)
            $Cortador <- TRUE
          }
        }
        case (w8) {
          frame False, Default {
            w2 = $"Contador pz"
          }
          frame True {
            Increment(x=$"Contador pz") -> w2
          }
        }
        Is Equal(x=w2, y=$Piezas) -> w9
        case (w9) {
          frame False, Default { }
          frame True {
            $"Código pz" <- "0"
          }
        }
        Wait(time to wait=15)
        $Avance <- TRUE
        $Encoder <- w7
        case (w8) {
          frame False, Default {
            w1 = w7
          }
          frame True {
            Subtract(x=w7, y=183) -> w1
          }
        }
        $Rodillos <- TRUE
        w3 = "91X244"
      }
      frame "91X305" {
        Add(s1, 1) -> w10
        Is Greater Or Equal(x=w10, y=183) -> w11
        case (w11) {
          frame False, Default {
            w2 = $"Contador pz"
          }
          frame True {
            Increment(x=$"Contador pz") -> w2
          }
        }
        Is Equal(x=w2, y=$Piezas) -> w12
        case (w12) {
          frame False, Default { }
          frame True {
            $"Código pz" <- "0"
          }
        }
        case (w11) {
          frame False, Default {
            $Cortador <- FALSE
          }
          frame True {
            Wait(time to wait=300)
            $Cortador <- TRUE
          }
        }
        Wait(time to wait=15)
        $Avance <- TRUE
        $Encoder <- w10
        case (w11) {
          frame False, Default {
            w1 = w10
          }
          frame True {
            Subtract(x=w10, y=183) -> w1
          }
        }
        $Rodillos <- TRUE
        w3 = "91X305"
      }
      frame "91X366" {
        Add(s1, 1) -> w13
        Is Greater Or Equal(x=w13, y=183) -> w14
        case (w14) {
          frame False, Default {
            w2 = $"Contador pz"
          }
          frame True {
            Increment(x=$"Contador pz") -> w2
          }
        }
        Is Equal(x=w2, y=$Piezas) -> w15
        case (w15) {
          frame False, Default { }
          frame True {
            $"Código pz" <- "0"
          }
        }
        case (w14) {
          frame False, Default {
            $Cortador <- FALSE
          }
          frame True {
            Wait(time to wait=300)
            $Cortador <- TRUE
          }
        }
        Wait(time to wait=15)
        $Avance <- TRUE
        $Encoder <- w13
        case (w14) {
          frame False, Default {
            w1 = w13
          }
          frame True {
            Subtract(x=w13, y=183) -> w1
          }
        }
        $Rodillos <- TRUE
        w3 = "91X366"
      }
      frame "91X914" {
        Add(s1, 1) -> w16
        Is Greater Or Equal(x=w16, y=183) -> w17
        case (w17) {
          frame False, Default {
            w2 = $"Contador pz"
          }
          frame True {
            Increment(x=$"Contador pz") -> w2
          }
        }
        Is Equal(x=w2, y=$Piezas) -> w18
        case (w18) {
          frame False, Default { }
          frame True {
            $"Código pz" <- "0"
          }
        }
        case (w17) {
          frame False, Default {
            $Cortador <- FALSE
          }
          frame True {
            Wait(time to wait=300)
            $Cortador <- TRUE
          }
        }
        Wait(time to wait=15)
        $Avance <- TRUE
        $Encoder <- w16
        case (w17) {
          frame False, Default {
            w1 = w16
          }
          frame True {
            Subtract(x=w16, y=183) -> w1
          }
        }
        $Rodillos <- TRUE
        w3 = "91X914"
      }
      frame "91X1220" {
        Add(s1, 1) -> w19
        Is Greater Or Equal(x=w19, y=183) -> w20
        case (w20) {
          frame False, Default {
            w2 = $"Contador pz"
          }
          frame True {
            Increment(x=$"Contador pz") -> w2
          }
        }
        Is Equal(x=w2, y=$Piezas) -> w21
        case (w21) {
          frame False, Default { }
          frame True {
            $"Código pz" <- "0"
          }
        }
        case (w20) {
          frame False, Default {
            $Cortador <- FALSE
          }
          frame True {
            Wait(time to wait=300)
            $Cortador <- TRUE
          }
        }
        Wait(time to wait=15)
        $Avance <- TRUE
        $Encoder <- w19
        case (w20) {
          frame False, Default {
            w1 = w19
          }
          frame True {
            Subtract(x=w19, y=183) -> w1
          }
        }
        $Rodillos <- TRUE
        w3 = "91X1220"
      }
      frame "91X1400" {
        Add(s1, 1) -> w22
        Is Greater Or Equal(x=w22, y=183) -> w23
        case (w23) {
          frame False, Default {
            w2 = $"Contador pz"
          }
          frame True {
            Increment(x=$"Contador pz") -> w2
          }
        }
        Is Equal(x=w2, y=$Piezas) -> w24
        case (w24) {
          frame False, Default { }
          frame True {
            $"Código pz" <- "0"
          }
        }
        case (w23) {
          frame False, Default {
            $Cortador <- FALSE
          }
          frame True {
            Wait(time to wait=300)
            $Cortador <- TRUE
          }
        }
        Wait(time to wait=15)
        $Avance <- TRUE
        $Encoder <- w22
        case (w23) {
          frame False, Default {
            w1 = w22
          }
          frame True {
            Subtract(x=w22, y=183) -> w1
          }
        }
        $Rodillos <- TRUE
        w3 = "91X1400"
      }
    }
    Concatenate Strings(w3, "-") -> w25
    Number To Decimal String(number=w2, width (-)=1) -> (decimal integer string=w26)
    String Subset(length (rest)=1, offset (0)=0, string=w26) -> w27
    Concatenate Strings(w27, "-") -> w28
    Format Date Time String() -> (date/time string=w29)
    Concatenate Strings(w25, w28, w29) -> w30
    $Registro <- w30
    $"Contador pz" <- w2
    next s1 = w1
    stop if $Paro
  }
